# Grasshopper definition Shaders_test.gh (Grasshopper 1.0.8)
# plug-ins: Heteroptera, Human, ghgl

number_slider = Slider(37, range=0..100)
random = Random(Number=1, seed=-112490)
construct_domain = ConstructDomain(DomainStart=expr("x/-2", number_slider), DomainEnd=expr("x/2", number_slider))
multiplication = Multiplication(A=random, B=10000)
number_slider_2 = Slider(100, range=0..100)
rectangle = Rectangle(Plane=PlaneXY(0, 0, 0), XSize=Slider(100, range=0..100), YSize=construct_domain, Radius=0)  # -> Rectangle, Length
construct_domain_2 = ConstructDomain(DomainStart=Slider(1, range=0..10), DomainEnd=Slider(69, range=0..100))
populate_2d = Populate2D(Region=rectangle.Rectangle, Count=number_slider_2, Seed=multiplication)
multiplication_2 = Multiplication(A=number_slider_2, B=3)
random_2 = Random(Range=construct_domain_2, Number=multiplication_2, Seed="9169")
construct_domain_3 = ConstructDomain(DomainStart=Slider(1, range=0..10), DomainEnd=Slider(25, range=0..100))
power = Power(A=random_2, B=Slider(6, range=0..20))
bounds = Bounds(Numbers=power)
number_slider_3 = Slider(195, range=0..1000)
series = Series(Start=0, Step=1, Count=number_slider_2)
remap_numbers = RemapNumbers(Value=power, Source=bounds, Target=construct_domain_3)  # -> Mapped, Clipped
list_item = ListItem(List=remap_numbers.Mapped, Index=series, Wrap=True)  # -> Item, Item1, Item2
construct_domain_4 = ConstructDomain(DomainStart=expr("x/-2", number_slider_3), DomainEnd=expr("x/2", number_slider_3))
multiplication_3 = Multiplication(A=list_item.Item)
trigger = Trigger(Interval=500, TimerInterval=500, Target=c_script)
multiplication_4 = Multiplication(A=list_item.Item1)
rectangle_2 = Rectangle(Plane=PlaneXY(0, 0, 0), XSize=Slider(100, range=0..100), YSize=construct_domain_4, Radius=0)  # -> Rectangle, Length
panel = Panel("""545
262
183""")
center_box = CenterBox(Base=populate_2d, X=multiplication_3, Y=multiplication_4, Z=list_item.Item2)
deconstruct_brep = DeconstructBrep(Brep=center_box)  # -> Faces, Edges, Vertices
pi = Pi(Factor=1)
c_script = CSharpScript()  # -> out, A
# ---------- c_script: C# ----------
    var vp = doc.Views.ActiveView.ActiveViewport;
    //save camera location and camera target
    var loc = vp.CameraLocation;
    var tar = vp.CameraTarget;
    A = tar;
# ---------- end c_script ----------
text_tag_3d = TextTag3D(Location=c_script.A, Text="target", Size=Slider(8, range=0..100), Justification=5)  # disabled
list_item_2 = ListItem(List=deconstruct_brep.Faces, Index=Slider(1, range=0..10), Wrap=True)  # -> flatten(Item)
deconstruct_brep_2 = DeconstructBrep(Brep=list_item_2)  # -> Faces, Edges, Vertices
closest_point = ClosestPoint(Point=c_script.A, Cloud=deconstruct_brep_2.Vertices)  # -> ClosestPoint, CPIndex, flatten(Distance)
sort_list = SortList(Keys=closest_point.Distance, ValuesValuesA=list_item_2)  # -> Keys, ValuesValuesA
split_list = SplitList(List=sort_list.ValuesValuesA, Index=Slider(19, range=0..100))  # -> ListA, ListB
list_item_3 = ListItem(List=deconstruct_brep.Faces, Index=0, Wrap=True)  # -> flatten(Item)
substrate = Substrate(Border=rectangle_2.Rectangle, Count=Slider(42, range=0..100), Angles=pi, Deviation=0, Seed=panel)
list_item_4 = ListItem(List=deconstruct_brep.Faces, Index=Slider(5, range=0..10), Wrap=True)  # -> flatten(Item)
deconstruct_brep_3 = DeconstructBrep(Brep=list_item_3)  # -> Faces, Edges, Vertices
closest_point_2 = ClosestPoint(Point=c_script.A, Cloud=deconstruct_brep_3.Vertices)  # -> ClosestPoint, CPIndex, flatten(Distance)
list_item_5 = ListItem(List=deconstruct_brep.Faces, Index=Slider(7, range=0..10), Wrap=True)  # -> flatten(Item)
area = Area(Geometry=list_item_5)  # -> Area, Centroid
area_2 = Area(Geometry=split_list.ListA)  # -> Area, Centroid
area_3 = Area(Geometry=list_item_4)  # -> Area, Centroid
list_length = ListLength(List=list_item_5)
number_slider_4 = Slider(25, range=0..100)
number_slider_5 = Slider(12, range=0..100)
toggle_wireframe = BooleanToggle(True)
list_length_2 = ListLength(List=split_list.ListA)
list_length_3 = ListLength(List=list_item_4)
sort_list_2 = SortList(Keys=area.Area, ValuesValuesA=list_item_5)  # -> Keys, ValuesValuesA
custom_preview_lineweights = CustomPreviewLineweights(Geometry=substrate, Shader=ColourSwatch(SwatchColor=RGBA(56, 56, 56, 51)), Absolute=False)
sort_list_3 = SortList(Keys=closest_point_2.Distance, ValuesValuesA=list_item_3)  # -> Keys, ValuesValuesA
split_list_2 = SplitList(List=sort_list_3.ValuesValuesA, Index=number_slider_5)  # -> ListA, ListB
list_length_4 = ListLength(List=split_list_2.ListB)
sort_list_4 = SortList(Keys=area_2.Area, ValuesValuesA=split_list.ListA)  # -> Keys, ValuesValuesA
multiplication_5 = Multiplication(A=list_length, B=Slider(1, range=0..1))
sort_list_5 = SortList(Keys=area_3.Area, ValuesValuesA=list_item_4)  # -> Keys, ValuesValuesA
multiplication_6 = Multiplication(A=list_length, B=Slider(0.1, range=0..1))
subtraction = Subtraction(A=list_length_4, B=Slider(67, range=0..100))
multiplication_7 = Multiplication(A=list_length_2, B=Slider(0.62, range=0..1))
multiplication_8 = Multiplication(A=list_length_3, B=Slider(0.94, range=0..1))
multiplication_9 = Multiplication(A=list_length_3, B=Slider(0.6, range=0..1))
mesh_edges = GLMeshShader(
    Mesh=center_box,
    WireframeColor=ColourSwatch(SwatchColor=RGBA(158, 158, 158, 118)),
    _toggleEffect=toggle_wireframe,
    DepthTestingEnabled=True,
    DepthWritingEnabled=True,
    DrawMode=1,
    FragmentShader="""#version 330

in vec3 normal;
out vec4 FragColor;

uniform bool _toggleEffect;
uniform vec4 wireframeColor;


void main()
{
  if (_toggleEffect) {
    FragColor = vec4(wireframeColor);
  } else {
    discard;
  }
}""",
    GLShader=(0, 1, 0),
    PreviewSortOrder=10,
    VertexShader="""#version 330

layout(location = 0) in vec3 _meshVertex;
layout(location = 1) in vec3 _meshNormal;

uniform mat4 _worldToClip;
out vec3 normal;

void main() 
{
  normal = _meshNormal;
  gl_Position = _worldToClip * vec4(_meshVertex, 1.0);
}""",
    glLineWidth=1,
    glPointSize=1)
construct_domain_5 = ConstructDomain(DomainStart=multiplication_6, DomainEnd=multiplication_5)
split_list_3 = SplitList(List=split_list_2.ListB, Index=subtraction)  # -> ListA, ListB
split_list_4 = SplitList(List=sort_list_4.ValuesValuesA, Index=multiplication_7)  # -> ListA, ListB
toggle_normal_map = BooleanToggle(True)
construct_domain_6 = ConstructDomain(DomainStart=multiplication_9, DomainEnd=multiplication_8)
sub_list = SubList(List=sort_list_5.ValuesValuesA, Domain=construct_domain_6, Wrap=True)  # -> List, Index
data = Data(split_list_2.ListA)
data_2 = Data(split_list_3.ListB)
data_3 = Data(sub_list.List)
deconstruct_brep_4 = DeconstructBrep(Brep=data)  # -> Faces, Edges, Vertices
sub_list_2 = SubList(List=sort_list_2.ValuesValuesA, Domain=construct_domain_5, Wrap=True)  # -> List, Index
distance = Distance(PointA=deconstruct_brep_4.Vertices, PointB=c_script.A)
deconstruct_brep_5 = DeconstructBrep(Brep=data_2)  # -> Faces, Edges, Vertices
data_4 = Data(split_list_3.ListA)
distance_2 = Distance(PointA=deconstruct_brep_5.Vertices, PointB=c_script.A)
toggle_normal_map_2 = BooleanToggle(True)
deconstruct_brep_6 = DeconstructBrep(Brep=data_3)  # -> Faces, Edges, Vertices
curve = Curve(data_4)
distance_3 = Distance(PointA=deconstruct_brep_6.Vertices, PointB=c_script.A)
# order=1
normal = GLMeshShader(
    Mesh=split_list_4.ListA,
    Setcolor=ColourSwatch(SwatchColor=RGB(99, 15, 15)),
    _toggleEffect=toggle_normal_map,
    DepthTestingEnabled=True,
    DepthWritingEnabled=True,
    DrawMode=4,
    FragmentShader="""#version 330

in vec4 colorvalue;
uniform bool _toggleEffect; // boolean to control the effect
out vec4 fragment_color;

void main() 
{
    if (_toggleEffect) {
        // Map the normal from [-1,1] to [0,1]


        fragment_color = colorvalue;
    } else {
        discard;
    }
}""",
    GLShader=(0, 2, 0),
    PreviewSortOrder=10,
    VertexShader="""#version 330

layout(location = 0) in vec3 _meshVertex;
uniform vec4 setcolor;

uniform mat4 _worldToClip;
uniform bool _toggleEffect;  // boolean to control the effect
out vec4 colorvalue;

void main() {
  colorvalue = setcolor;
  gl_Position = _worldToClip * vec4(_meshVertex, 1.0);
}""",
    glLineWidth=3,
    glPointSize=8)  # -> Color, Depth
sort_list_6 = SortList(Keys=distance, ValuesValuesA=deconstruct_brep_4.Vertices)  # -> Keys, ValuesValuesA
simple_mesh = SimpleMesh(Brep=data)
length = Length(Curve=curve)
sort_list_7 = SortList(Keys=distance_2, ValuesValuesA=deconstruct_brep_5.Vertices)  # -> Keys, reverse(ValuesValuesA)
simple_mesh_2 = SimpleMesh(Brep=data_2)
simple_mesh_3 = SimpleMesh(Brep=data_4)
area_4 = Area(Geometry=simple_mesh_3)  # -> Area, Centroid
sort_list_8 = SortList(Keys=distance_3, ValuesValuesA=deconstruct_brep_6.Vertices)  # -> Keys, reverse(ValuesValuesA)
simple_mesh_4 = SimpleMesh(Brep=data_3)
list_item_6 = ListItem(List=sort_list_6.ValuesValuesA, Index=0, Wrap=True)  # -> flatten(Item)
list_item_7 = ListItem(List=reverse(sort_list_6.ValuesValuesA), Index=0, Wrap=True)  # -> flatten(Item)
list_item_8 = ListItem(List=sort_list_7.ValuesValuesA, Index=0, Wrap=True)  # -> flatten(Item)
list_item_9 = ListItem(List=reverse(sort_list_7.ValuesValuesA), Index=0, Wrap=True)  # -> flatten(Item)
square_root = SquareRoot(Value=area_4.Area)
list_length_5 = ListLength(List=simple_mesh_3)
# order=9
normal_2 = GLMeshShader(
    Mesh=sub_list_2.List,
    Setcolor=ColourSwatch(SwatchColor=RGBA(0, 0, 0, 99)),
    _toggleEffect=toggle_normal_map_2,
    DepthTestingEnabled=True,
    DepthWritingEnabled=True,
    DrawMode=4,
    FragmentShader="""#version 330

in vec4 colorvalue;
uniform bool _toggleEffect; // boolean to control the effect
out vec4 fragment_color;

void main() 
{
    if (_toggleEffect) {
        // Map the normal from [-1,1] to [0,1]


        fragment_color = colorvalue;
    } else {
        discard;
    }
}""",
    GLShader=(0, 2, 0),
    PreviewSortOrder=9,
    VertexShader="""#version 330

layout(location = 0) in vec3 _meshVertex;
uniform vec4 setcolor;

uniform mat4 _worldToClip;
uniform bool _toggleEffect;  // boolean to control the effect
out vec4 colorvalue;

void main() {
  colorvalue = setcolor;
  gl_Position = _worldToClip * vec4(_meshVertex, 1.0);
}""",
    glLineWidth=3,
    glPointSize=8)  # -> Color, Depth
division = Division(A=length, B=square_root)
split_ahsv = SplitAHSV(Colour=ColourSwatch(SwatchColor=RGB(81, 131, 185)))  # -> Alpha, Hue, Saturation, Value
list_item_10 = ListItem(List=reverse(sort_list_8.ValuesValuesA), Index=0, Wrap=True)  # -> flatten(Item)
list_item_11 = ListItem(List=sort_list_8.ValuesValuesA, Index=0, Wrap=True)  # -> flatten(Item)
split_list_5 = SplitList(List=list_item_6, Index=number_slider_5)  # -> ListA, ListB
split_list_6 = SplitList(List=list_item_7, Index=number_slider_5)  # -> ListA, ListB
sort_list_9 = SortList(Keys=division, ValuesValuesA=simple_mesh_3)  # -> Keys, ValuesValuesA
split_list_7 = SplitList(List=list_item_8, Index=number_slider_4)  # -> ListA, ListB
split_list_8 = SplitList(List=list_item_9, Index=number_slider_4)  # -> ListA, ListB
random_3 = Random(Range=Slider(0.02, range=0..1), Number=list_length_5, Seed=2)
range = Range(Domain=Slider(-0.1, range=-1..1), Steps=expr("x-1", list_length_5))
toggle_radial_gradient = BooleanToggle(True)
range_2 = Range(Domain=Slider(0.61, range=-1..1), Steps=expr("x-1", list_length_5))
toggle_radial_gradient_2 = BooleanToggle(True)
colour_swatch = ColourSwatch(SwatchColor=RGB(78, 120, 166))
toggle_radial_gradient_3 = BooleanToggle(True)
graph_mapper = GraphMapper(range_2, x0=0, x1=1, y0=0, y1=1, Cx=0.6851488352, Cy=0.1676949859, container_name="Conic")
addition = Addition(A=random_3, B=split_ahsv.Hue)
addition_2 = Addition(A=split_ahsv.Saturation, B=range)
radial_gradient = GLMeshShader(
    Mesh=flatten(simple_mesh),
    CenterPoint=split_list_5.ListA,
    OuterPoint=split_list_6.ListA,
    InnerColor=ColourSwatch(SwatchColor=RGB(255, 255, 255)),
    OuterColor=colour_swatch,
    _toggleEffect=toggle_radial_gradient,
    DepthTestingEnabled=True,
    DepthWritingEnabled=True,
    DrawMode=4,
    FragmentShader="""#version 330

uniform vec3 centerPoint;
uniform vec3 outerPoint;
uniform vec4 innerColor;
uniform vec4 outerColor;
uniform bool _toggleEffect;  // boolean to control the effect

in vec3 vertex;
out vec4 fragment_color;

void main()
{
  if (_toggleEffect) {
    vec3 center = centerPoint;
    float totalDistance = distance(outerPoint, center);
    float distanceToCenter = distance(vertex, center);
    float t = distanceToCenter / totalDistance;
  
    t = clamp(t, 0.0, 1.0);
    vec4 color = mix(innerColor, outerColor, t);
    fragment_color = color;
  } else {
    fragment_color = vec4(0.0, 0.0, 0.0, 0.0);  // Transparent if _toggleEffect is false
  }
}""",
    GLShader=(0, 1, 0),
    PreviewSortOrder=3,
    VertexShader="""#version 330

layout(location = 0) in vec3 _meshVertex;

uniform mat4 _worldToClip;

out vec3 vertex;

void main() 
{
  vertex = _meshVertex;
  gl_Position = _worldToClip * vec4(_meshVertex, 1.0);
}""",
    glLineWidth=3,
    glPointSize=8)
radial_gradient_2 = GLMeshShader(
    Mesh=flatten(simple_mesh_2),
    CenterPoint=split_list_7.ListA,
    OuterPoint=split_list_8.ListA,
    InnerColor=ColourSwatch(SwatchColor=RGBA(0, 0, 0, 0)),
    OuterColor=colour_swatch,
    _toggleEffect=toggle_radial_gradient_2,
    DepthTestingEnabled=True,
    DepthWritingEnabled=True,
    DrawMode=4,
    FragmentShader="""#version 330

uniform vec3 centerPoint;
uniform vec3 outerPoint;
uniform vec4 innerColor;
uniform vec4 outerColor;
uniform bool _toggleEffect;  // boolean to control the effect

in vec3 vertex;
out vec4 fragment_color;

void main()
{
  if (_toggleEffect) {
    vec3 center = centerPoint;
    float totalDistance = distance(outerPoint, center);
    float distanceToCenter = distance(vertex, center);
    float t = distanceToCenter / totalDistance;
  
    t = clamp(t, 0.0, 1.0);
    vec4 color = mix(innerColor, outerColor, t);
    fragment_color = color;
  } else {
    fragment_color = vec4(0.0, 0.0, 0.0, 0.0);  // Transparent if _toggleEffect is false
  }
}""",
    GLShader=(0, 1, 0),
    PreviewSortOrder=2,
    VertexShader="""#version 330

layout(location = 0) in vec3 _meshVertex;

uniform mat4 _worldToClip;

out vec3 vertex;

void main() 
{
  vertex = _meshVertex;
  gl_Position = _worldToClip * vec4(_meshVertex, 1.0);
}""",
    glLineWidth=3,
    glPointSize=8)
addition_3 = Addition(A=split_ahsv.Value, B=graph_mapper)
radial_gradient_3 = GLMeshShader(
    Mesh=flatten(simple_mesh_4),
    CenterPoint=list_item_11,
    OuterPoint=list_item_10,
    InnerColor=ColourSwatch(SwatchColor=RGBA(0, 0, 0, 0)),
    OuterColor=ColourSwatch(SwatchColor=RGB(78, 120, 166)),
    _toggleEffect=toggle_radial_gradient_3,
    DepthTestingEnabled=True,
    DepthWritingEnabled=True,
    DrawMode=4,
    FragmentShader="""#version 330

uniform vec3 centerPoint;
uniform vec3 outerPoint;
uniform vec4 innerColor;
uniform vec4 outerColor;
uniform bool _toggleEffect;  // boolean to control the effect

in vec3 vertex;
out vec4 fragment_color;

void main()
{
  if (_toggleEffect) {
    vec3 center = centerPoint;
    float totalDistance = distance(outerPoint, center);
    float distanceToCenter = distance(vertex, center);
    float t = distanceToCenter / totalDistance;
  
    t = clamp(t, 0.0, 1.0);
    vec4 color = mix(innerColor, outerColor, t);
    fragment_color = color;
  } else {
    fragment_color = vec4(0.0, 0.0, 0.0, 0.0);  // Transparent if _toggleEffect is false
  }
}""",
    GLShader=(0, 1, 0),
    PreviewSortOrder=1,
    VertexShader="""#version 330

layout(location = 0) in vec3 _meshVertex;

uniform mat4 _worldToClip;

out vec3 vertex;

void main() 
{
  vertex = _meshVertex;
  gl_Position = _worldToClip * vec4(_meshVertex, 1.0);
}""",
    glLineWidth=3,
    glPointSize=8)
toggle_normal_map_3 = BooleanToggle(True)
colour_hsv = ColourHSV(Alpha=1, Hue=addition, Saturation=addition_2, Value=addition_3)
colour = Colour(colour_hsv)
# order=1
normal_3 = GLMeshShader(
    Mesh=sort_list_9.ValuesValuesA,
    Setcolor=colour,
    _toggleEffect=toggle_normal_map_3,
    DepthTestingEnabled=True,
    DepthWritingEnabled=True,
    DrawMode=4,
    FragmentShader="""#version 330

in vec4 colorvalue;
uniform bool _toggleEffect; // boolean to control the effect
out vec4 fragment_color;

void main() 
{
    if (_toggleEffect) {
        // Map the normal from [-1,1] to [0,1]


        fragment_color = colorvalue;
    } else {
        discard;
    }
}""",
    GLShader=(0, 2, 0),
    PreviewSortOrder=2,
    VertexShader="""#version 330

layout(location = 0) in vec3 _meshVertex;
uniform vec4 setcolor;

uniform mat4 _worldToClip;
uniform bool _toggleEffect;  // boolean to control the effect
out vec4 colorvalue;

void main() {
  colorvalue = setcolor;
  gl_Position = _worldToClip * vec4(_meshVertex, 1.0);
}""",
    glLineWidth=3,
    glPointSize=8)  # -> Color, Depth
